# Grasshopper definition Compas-Eve-Example.gh (Grasshopper 1.0.7)

# ----
# 在方格內一個一個隨機生成點
python = GhPythonScript()  # -> do_something; disabled
# ---------- python: Python ----------
__author__ = "David Chang"
__version__ = "2025.01.06"


import time
import random
import Rhino.Geometry as rg

# The following code is based on the COMPAS EVA official API documentation.
# For more details, refer to the official API reference.

def do_something(worker): #<do_something>名稱需與輸出端口一致
    result = []

    for i in range(100):
        x, y = random.randint(0, 100), random.randint(0, 100)
        result.append(rg.Point3d(x, y, 0))
        worker.update_result(result)
        time.sleep(0.01)

    worker.display_message("Done!")

    return result
# ---------- end python ----------
toggle = BooleanToggle(False)  # disabled
button = Button()  # disabled
bg_task = BackgroundTask(task=python, reset=button, on=toggle)  # -> result; inputs on: Boolean; disabled
#   port task: A Python function that will be executed by the background worker. The function does not need to return quickly, it can even have an infinite loop and keep running, it will not block the UI.
# ---------- bg_task: Python ----------
"""
Background Task component.

Executes a long-running task in the background, while keeping Grasshopper reactive.

COMPAS EVE v1.0.0
"""

import threading
import scriptcontext as sc

from compas_eve.ghpython import BackgroundWorker
from ghpythonlib.componentbase import executingcomponent as component


DEBUG = False


class BackgroundTaskComponent(component):
    def RunScript(self, task, reset, on):
        if not on:
            BackgroundWorker.stop_instance_by_component(ghenv)  # noqa: F821
            return None

        self.worker = BackgroundWorker.instance_by_component(ghenv, task, force_new=reset)  # noqa: F821

        if not self.worker.is_working() and not self.worker.is_done() and reset:
            self.worker.start_work()

        print("Worker ID: {}".format(id(self.worker)))
        print("Is worker running? {}".format(self.worker.is_working()))
        print("Worker completed? {}".format(self.worker.is_done()))
        if hasattr(self.worker, "thread"):
            print("Worker thread: {}".format(self.worker.thread))

        if DEBUG:
            other_workers = []
            for key in sc.sticky.keys():
                if key.startswith("background_worker_"):
                    worker = sc.sticky[key]
                    if worker != self.worker:
                        other_workers.append(worker)

            if len(other_workers):
                print
                print("Found {} more workers:".format(len(other_workers)))
                for worker in other_workers:
                    print("* Worker ID: {}".format(id(worker)))
                    print(" - Is worker running? {}".format(worker.is_working()))
                    print(" - Worker completed? {}".format(worker.is_done()))
                    print(" - Worker thread: {}".format(worker.thread))

            non_main_threads = [thread for thread in threading.enumerate() if thread.name != "MainThread"]
            if len(non_main_threads):
                print
                print("Found {} background threads running:".format(len(non_main_threads)))
                for thread in non_main_threads:
                    print(" - " + thread.name)

        if hasattr(self.worker, "result"):
            return self.worker.result
        else:
            return None
# ---------- end bg_task ----------

# ---- group: 設置障礙物
crv = Curve([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])  # disabled

# ----
# 計算VGA
number_slider = Slider(2, range=0..10)  # disabled
brep = Brep(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)  # disabled
button_2 = Button()  # disabled
toggle_2 = BooleanToggle(False)  # disabled
number_slider_2 = Slider(0.5, range=0..1)  # disabled
swatch = ColourSwatch(SwatchColor=RGB(255, 255, 255))  # disabled

# ---- group: 生成Grid
python_2 = GhPythonScript(movable_area_brep=brep, spacing=number_slider)  # -> a; inputs movable_area_brep: Brep; disabled
# ---------- python_2: Python ----------
import Rhino.Geometry as rg

def generate_grid_points(brep, spacing):
    """在指定的Brep內生成網格點，適用於平面或曲線邊界
    :param brep: 可移動區域的Brep
    :param spacing: 網格間距
    :return: 可移動區域內的網格點列表
    """
    # 獲取Brep的邊界框
    bbox = brep.GetBoundingBox(True)
    points = []

    # 將 Brep 邊界轉換為 Curve，以便在平面內檢查點是否在範圍內
    boundary_curves = brep.DuplicateEdgeCurves()  # 提取邊界曲線
    boundary = rg.Curve.JoinCurves(boundary_curves)[0]  # 合併為單一閉合曲線

    # 在邊界框內生成網格點
    x_min, y_min, z_min = bbox.Min.X, bbox.Min.Y, bbox.Min.Z
    x_max, y_max, z_max = bbox.Max.X, bbox.Max.Y, bbox.Max.Z

    z = z_min  # 固定 Z 軸高度
    y = y_min
    while y <= y_max:
        x = x_min
        while x <= x_max:
            pt = rg.Point3d(x, y, z)
            # 使用 Curve.Contains 檢查點是否在可移動區域內
            if boundary.Contains(pt, rg.Plane.WorldXY, 0.01) == rg.PointContainment.Inside:
                points.append(pt)
            x += spacing
        y += spacing

    return points

# 調用生成網格點的函數，spacing從外部端口輸入
grid_points = generate_grid_points(movable_area_brep, spacing)

# 將生成的網格點輸出到Grasshopper
a = grid_points  # 輸出到外部端口"a"
# ---------- end python_2 ----------

# ----
pt = Point(python_2)  # disabled
同時export_vg_in_compas = GhPythonScript(pts=pt, obstacles=crv)  # -> main_task; inputs pts: list of Point3d, obstacles: list of Curve; disabled
# ---------- 同時export_vg_in_compas: Python ----------
import Rhino.Geometry as rg
import math

# 計算單一視域多邊形的函數
def calculate_isovist(center, obstacles, nOfRays, radius):
    angle_step = (2 * math.pi) / nOfRays
    isovist_points = []

    for i in range(nOfRays):
        angle = i * angle_step
        direction = rg.Vector3d(math.cos(angle), math.sin(angle), 0)
        ray = rg.Line(center, direction * radius)
        
        closest_point = None
        closest_distance = radius

        for obstacle in obstacles:
            segments = obstacle.DuplicateSegments()

            for segment in segments:
                if isinstance(segment, rg.LineCurve):
                    line = segment.Line
                elif isinstance(segment, rg.Line):
                    line = segment
                else:
                    continue
                
                result, a, b = rg.Intersect.Intersection.LineLine(ray, line, 0.01, True)
                
                if result:
                    intersection_point = ray.PointAt(a)
                    distance = center.DistanceTo(intersection_point)
                    if distance < closest_distance:
                        closest_distance = distance
                        closest_point = intersection_point

        if closest_point:
            isovist_points.append(closest_point)
        else:
            isovist_points.append(ray.PointAt(1))

    if isovist_points[0] != isovist_points[-1]:
        isovist_points.append(isovist_points[0])
    
    isovist_polyline_curve = rg.PolylineCurve(isovist_points)
    
    if isovist_polyline_curve.IsValid and isovist_polyline_curve.IsClosed:
        isovist_area = rg.AreaMassProperties.Compute(isovist_polyline_curve).Area
    else:
        isovist_area = 0

    return isovist_polyline_curve, isovist_area

# 生成可見性圖的函數
def build_visibility_graph(pts, obstacles):
    cleaned_pts = []
    for pt in pts:
        if isinstance(pt, rg.Point3d):
            cleaned_pts.append(pt)
        elif isinstance(pt, (tuple, list)) and len(pt) == 3:
            cleaned_pts.append(rg.Point3d(pt[0], pt[1], pt[2]))

    visibility_graph = []
    for i in range(len(cleaned_pts)):
        for j in range(i + 1, len(cleaned_pts)):
            start = cleaned_pts[i]
            end = cleaned_pts[j]
            line_curve = rg.Line(start, end).ToNurbsCurve()
            
            is_visible = True
            for obstacle in obstacles:
                intersections = rg.Intersect.Intersection.CurveCurve(line_curve, obstacle, 0.01, 0.01)
                if intersections.Count > 0:
                    is_visible = False
                    break
            
            if is_visible:
                visibility_graph.append((i, j))

    return visibility_graph, cleaned_pts

# 計算聚合係數
def calculate_clustering_coefficient(node, visibility_graph):
    neighbors = [n2 if n1 == node else n1 for n1, n2 in visibility_graph if n1 == node or n2 == node]
    
    if len(neighbors) < 2:
        return 1.0
    
    connections = 0
    for i in range(len(neighbors)):
        for j in range(i + 1, len(neighbors)):
            if (neighbors[i], neighbors[j]) in visibility_graph or (neighbors[j], neighbors[i]) in visibility_graph:
                connections += 1

    max_connections = len(neighbors) * (len(neighbors) - 1) / 2  # C(n, 2) 組合數
    return connections / max_connections if max_connections > 0 else 1.0

# 計算平均深度
def calculate_mean_depth(node, visibility_graph):
    distances = []
    visited = set()
    queue = [(node, 0)]
    while queue:
        current, depth = queue.pop(0)
        if current not in visited:
            visited.add(current)
            distances.append(depth)
            for n1, n2 in visibility_graph:
                neighbor = n2 if n1 == current else n1 if n2 == current else None
                if neighbor and neighbor not in visited:
                    queue.append((neighbor, depth + 1))
    return sum(distances) / len(distances) if distances else 0

# 計算聚合係數和視野深度的主流程
def calculate_spatial_metrics(pts, obstacles):
    visibility_graph, cleaned_pts = build_visibility_graph(pts, obstacles)
    clustering_coefficients = []
    mean_depths = []

    for node in range(len(cleaned_pts)):
        clustering_coefficients.append(calculate_clustering_coefficient(node, visibility_graph))
        mean_depths.append(calculate_mean_depth(node, visibility_graph))

    # 返回聚合係數、視野深度和可見性圖
    return clustering_coefficients, mean_depths, visibility_graph




# 主執行流程
def main_task(worker):
    # 主任务函数，调用 calculate_spatial_metrics
    clustering_coefficients, mean_depths, visibility_graph = calculate_spatial_metrics(pts, obstacles)
    
    # 实时更新结果
    worker.update_result((clustering_coefficients, mean_depths, visibility_graph))
    worker.display_message("Done!")
    
    # 确保返回的数据结构为嵌套的标准 Python 列表
    clustering_coefficients = [float(x) for x in clustering_coefficients]  # 将每个元素转换为标准 float
    mean_depths = [float(y) for y in mean_depths]  # 将每个元素转换为标准 float

    # 将结果保持为嵌套列表
    result = [clustering_coefficients, mean_depths, visibility_graph]
    
    return result


# 輸出 main_task 給BGTask
# ---------- end 同時export_vg_in_compas ----------
data = Data(pt)  # disabled
bg_task_2 = BackgroundTask(task=同時export_vg_in_compas, reset=button_2, on=toggle_2)  # -> result; inputs on: Boolean; disabled; same code as bg_task
convert_ironpython_list = GhPythonScript(result=bg_task_2)  # -> a, b, c; inputs result: list; disabled
# ---------- convert_ironpython_list: Python ----------
clustering_coefficients = result[0]
mean_depths = result[1]
visibility_graph = result[2]

# 输出到各个端口
a = clustering_coefficients
b = mean_depths
c = visibility_graph
# ---------- end convert_ironpython_list ----------
線視覺化 = GhPythonScript(visibility_graph=convert_ironpython_list.c, pts=data)  # -> a; inputs visibility_graph: list, pts: list of Point3d; disabled
# ---------- 線視覺化: Python ----------
import Rhino.Geometry as rg
from System.Drawing import Color

# 輸入
# visibility_graph: 由計算組件輸出的可見點對索引列表
# pts: 節點的點列表

# 構建可視化的線段列表
lines = []
for pair in visibility_graph:
    start = pts[pair[0]]
    end = pts[pair[1]]
    lines.append(rg.Line(start, end))

# 輸出線段列表供可視化
a = lines
# ---------- end 線視覺化 ----------
clustering_coefficients = Panel(convert_ironpython_list.a)  # disabled
sort = SortList(Keys=convert_ironpython_list.b, ValuesA=data)  # -> Keys, ValuesA; disabled
preview = CustomPreview(Geometry=線視覺化, Material=swatch)  # disabled
points = PointList(Points=sort.ValuesA, Size=number_slider_2)  # disabled
