# Grasshopper definition CompasRPCNumpyTest.gh (Grasshopper 1.0.7)

python = GhPythonScript(run=Toggle(False))  # -> a
# ---------- python: Python ----------
__author__ = "DavidChang"
__version__ = "2025.01.06"

from compas.rpc import Proxy

# 檢查 toggle 是否為 True
if run:
    # RPC 調用
    p = Proxy('server')

    array1 = [1, 2, 3]
    array2 = [4, 5, 6]
    result = p.add_arrays(array1, array2)

    # 輸出結果
    a = result
else:
    # toggle 為 False，輸出 None
    a = 'Set the toggle to "True" to start running......'
# ---------- end python ----------
panel = Panel(python)
